# Grasshopper definition T16.gh (Grasshopper 1.0.8)

surface = Surface(<surface referenced from the Rhino model>)
dimensions = Dimensions(Surface=surface)  # -> UDimension, VDimension
md_slider = MDSlider(
    SliderMode=0,
    slider_value=Point(0.5497816132, 0.6827578661, 0.5),
    x_domain=Domain(0, 1),
    y_domain=Domain(0, 1),
    z_domain=Domain(0, 1))
plane_surface = PlaneSurface(Plane=PlaneXY(0, 0, 0), XSize=dimensions.UDimension, YSize=dimensions.VDimension)
evaluate_surface = EvaluateSurface(Surface=reparameterize(plane_surface), Point=md_slider)  # -> Point, Normal, UDirection, VDirection, Frame
circle = Circle(Plane=evaluate_surface.Point, Radius=Slider(12.4, range=0..20))
populate_geometry = PopulateGeometry(Geometry=plane_surface, Count=Slider(67, range=0..100), Seed=Slider(11, range=0..100))
boundary_surfaces = BoundarySurfaces(Edges=circle)
populate_geometry_2 = PopulateGeometry(Geometry=boundary_surfaces, Count=Slider(34, range=0..100), Seed=1)
point = Point([populate_geometry_2, populate_geometry])
voronoi = Voronoi(Points=point, Radius=Slider(11.8, range=0..20), Boundary=plane_surface, BruteForceOverride=False)
fillet = Fillet(Curve=voronoi, Radius=Slider(2.7, range=0..10))
offset_curve = OffsetCurve(Curve=fillet, Distance=expr("-x", Slider(0.6, range=0..10)), Corners=1)  # -> simplify(flatten(Curve))
surface_split = SurfaceSplit(Surface=plane_surface, Curves=offset_curve)
number_slider = Slider(1.5, range=0..10)
cull_index = CullIndex(List=surface_split, Indices="0", Wrap=True)
list_item = ListItem(List=surface_split, Index=0, Wrap=True)
unit_z = UnitZ(Factor=number_slider)
unit_z_2 = UnitZ(Factor=number_slider)
move = Move(Geometry=cull_index, Motion=unit_z)  # -> Geometry, Transform
area = Area(Geometry=move.Geometry)  # -> Area, Centroid
unit_z_3 = UnitZ(Factor=Slider(3, range=0..10))
move_2 = Move(Geometry=area.Centroid, Motion=unit_z_3)  # -> simplify(graft(Geometry)), Transform
curve = Curve(simplify(graft(move.Geometry)))
extrude = Extrude(Base=list_item, Direction=unit_z_2)  # -> flatten(Extrusion)
patch = Patch(Curves=curve, Points=move_2.Geometry, Spans=15, Flexibility=1, Trim=True)  # -> flatten(Patch)
group = Group(Geometry=[extrude, patch])
bounding_box = BoundingBox(Content=group, Plane=PlaneXY(0, 0, 0))  # -> Box, Box_2
surface_morph = SurfaceMorph(
    Geometry=group,
    Reference=bounding_box.Box,
    Surface=reparameterize(surface),
    UDomain="1",
    VDomain="1",
    WDomain=number_slider)
ungroup = Ungroup(Group=surface_morph)
cull_index_2 = CullIndex(List=ungroup, Indices="0", Wrap=True)
list_item_2 = ListItem(List=ungroup, Index=0, Wrap=True)
create_material = CreateMaterial(
    Diffuse=ColourSwatch(SwatchColor=RGB(11, 47, 71)),
    Specular=RGB(255, 255, 255),
    Emission=RGB(0, 0, 0),
    Transparency=Slider(0, range=0..1),
    Shine=0)
create_material_2 = CreateMaterial(
    Diffuse=ColourSwatch(SwatchColor=RGB(93, 187, 201)),
    Specular=RGB(255, 255, 255),
    Emission=RGB(0, 0, 0),
    Transparency=Slider(0, range=0..1),
    Shine=0)
custom_preview = CustomPreview(Geometry=list_item_2, Material=create_material)
custom_preview_2 = CustomPreview(Geometry=cull_index_2, Material=create_material_2)
