# Grasshopper definition T17.1.gh (Grasshopper 1.0.8)

point = Point([<point referenced from the Rhino model> x31])
voronoi = Voronoi(
    Points=point,
    Boundary={Plane=PlaneXY(1.688488097, -0.07014458446, 0), Size=Domain2(u=-21.50895683..21.50895683, v=-19.59472928..19.59472928)},
    BruteForceOverride=False)
area = Area(Geometry=voronoi)  # -> Area, Centroid
bounds = Bounds(Numbers=area.Area)
division = Division(A=area.Area, B=Slider(2.871, range=0..5))
unit_z = UnitZ(Factor=division)
deconstruct_domain = DeconstructDomain(Domain=bounds)  # -> Start, End
extrude = Extrude(Base=voronoi, Direction=unit_z)
gradient = Gradient(
    LowerLimit=deconstruct_domain.Start,
    UpperLimit=deconstruct_domain.End,
    Parameter=area.Area,
    stops=[0: RGB(234, 38, 0), 0.25: RGB(234, 126, 0), 0.5: RGB(254, 244, 84), 0.75: RGB(173, 203, 249), 1: RGB(75, 107, 169)])
cap_holes = CapHoles(Brep=extrude)
custom_preview = CustomPreview(Geometry=cap_holes, Material=gradient)
