# Grasshopper definition T17.2.gh (Grasshopper 1.0.8)

number_slider = Slider(12.3, range=0..100)
number_slider_2 = Slider(21.2, range=0..100)
number_slider_3 = Slider(14.3, range=0..100)
unit_x = UnitX(Factor=number_slider)
unit_y = UnitY(Factor=number_slider_3)
unit_z = UnitZ(Factor=number_slider_2)
addition = Addition(A=unit_x, B=unit_y, C=unit_z)
xy_plane = XYPlane(Origin=Point(0, 0, 0))
move = Move(Geometry=xy_plane, Motion=addition)  # -> Geometry, Transform
center_box = CenterBox(Base=move.Geometry, X=number_slider, Y=number_slider_3, Z=number_slider_2)
populate_3d = Populate3D(Region=center_box, Count=Slider(40, range=0..1000), Seed=Slider(50, range=0..100))
voronoi_3d = Voronoi3D(Points=populate_3d)  # -> Cells, Boundary
deconstruct_brep = DeconstructBrep(Brep=voronoi_3d.Cells)  # -> simplify(Faces), Edges, Vertices
boundary_surfaces = BoundarySurfaces(Edges=deconstruct_brep.Faces)
deconstruct_brep_2 = DeconstructBrep(Brep=boundary_surfaces)  # -> simplify(Faces), Edges, simplify(Vertices)
area = Area(Geometry=deconstruct_brep_2.Faces)  # -> Area, Centroid
interpolate = Interpolate(Vertices=deconstruct_brep_2.Vertices, Degree=3, Periodic=True, KnotStyle=1)  # -> Curve, Length, Domain
scale = Scale(Geometry=interpolate.Curve, Center=area.Centroid, Factor=Slider(0.358, range=0..5))  # -> Geometry, Transform
surface_split = SurfaceSplit(Surface=deconstruct_brep_2.Faces, Curves=scale.Geometry)
md_slider = MDSlider(SliderMode=0, slider_value=Point(0.5, 0.5, 0.5), x_domain=Domain(0, 1), y_domain=Domain(0, 1), z_domain=Domain(0, 1))
cull_index = CullIndex(List=surface_split, Indices="0", Wrap=True)
curve = Curve(cull_index)
area_2 = Area(Geometry=cull_index)  # -> Area, Centroid
evaluate_surface = EvaluateSurface(Surface=cull_index, Point=md_slider)  # -> Point, Normal, UDirection, VDirection, Frame
multiplication = Multiplication(A=evaluate_surface.Normal, B=Slider(2.667, range=0..5))
move_2 = Move(Geometry=area_2.Centroid, Motion=multiplication)  # -> Geometry, Transform
patch = Patch(Curves=curve, Points=move_2.Geometry, Spans=10, Flexibility=1, Trim=True)
