# Grasshopper definition T18.gh (Grasshopper 1.0.8)
# plug-ins: Weaverbird

surface = Surface(<surface referenced from the Rhino model>)
dimensions = Dimensions(Surface=surface)  # -> UDimension, VDimension
plane = Plane(PlaneXY(0, 0, 0))
md_slider = MDSlider(
    SliderMode=0,
    slider_value=Point(0.6444979581, 0.4022204467, 0.5),
    x_domain=Domain(0, 1),
    y_domain=Domain(0, 1),
    z_domain=Domain(0, 1))
plane_surface = PlaneSurface(Plane=plane, XSize=dimensions.UDimension, YSize=dimensions.VDimension)
populate_geometry = PopulateGeometry(Geometry=plane_surface, Count=Slider(102, range=0..1000), Seed=Slider(20, range=0..100))  # -> flatten(Population)
evaluate_surface = EvaluateSurface(Surface=reparameterize(plane_surface), Point=md_slider)  # -> Point, Normal, UDirection, VDirection, Frame
circle = Circle(Plane=evaluate_surface.Point, Radius=Slider(15.43, range=0..20))
boundary_surfaces = BoundarySurfaces(Edges=circle)
populate_geometry_2 = PopulateGeometry(Geometry=boundary_surfaces, Count=Slider(45, range=0..100), Seed=1)  # -> flatten(Population)
voronoi = Voronoi(Points=[populate_geometry, populate_geometry_2], Boundary=plane_surface, BruteForceOverride=False)
area = Area(Geometry=voronoi)  # -> Area, Centroid
scale = Scale(Geometry=voronoi, Center=area.Centroid, Factor=Slider(0.71, range=0..1))  # -> Geometry, Transform
curve = Curve(simplify(graft(voronoi)))
curve_2 = Curve(simplify(graft(scale.Geometry)))
loft = Loft(
    Curves=[curve, curve_2],
    Options={Adjust=False, Closed=False, LoftEnds=0, LoftSimp=0, LoftType=0, Rebuild=10, Refit=0.01})
deconstruct_brep = DeconstructBrep(Brep=loft)  # -> simplify(Faces), Edges, Vertices
mesh_surface = MeshSurface(Surface=deconstruct_brep.Faces, UCount="1", VCount="1", Overhang=True, Equalize=False)  # -> flatten(Mesh)
weaverbird_s_join_meshes_and_weld = WeaverbirdsJoinMeshesAndWeld(Mesh=mesh_surface, Weld=Toggle(True))
weaverbird_s_catmull_clark_subdivision = WeaverbirdsCatmullClarkSubdivision(MeshCurves=weaverbird_s_join_meshes_and_weld, Level="3", SmoothNakedEdges=1)
number_slider = Slider(1.68, range=0..10)
weaverbird_s_mesh_thicken = WeaverbirdsMeshThicken(MeshCurves=weaverbird_s_catmull_clark_subdivision, Distance=number_slider, OffsetType=0)
bounding_box = BoundingBox(Content=weaverbird_s_mesh_thicken, Plane=PlaneXY(0, 0, 0))  # -> Box, Box_2
surface_morph = SurfaceMorph(
    Geometry=weaverbird_s_mesh_thicken,
    Reference=bounding_box.Box,
    Surface=reparameterize(surface),
    UDomain="1",
    VDomain="1",
    WDomain=number_slider)
