# Grasshopper definition T19.1.gh (Grasshopper 1.0.8)

brep = Brep(<brep referenced from the Rhino model>)
bounding_box = BoundingBox(Content=brep, Plane=PlaneXY(0, 0, 0))  # -> Box, Box_2
populate_3d = Populate3D(Region=bounding_box.Box, Count=Slider(50, range=0..100), Seed=Slider(34, range=0..100))
voronoi_3d = Voronoi3D(Points=populate_3d, Box=bounding_box.Box)  # -> simplify(graft(Cells)), Boundary
solid_intersection = SolidIntersection(BrepsA=brep, BrepsB=voronoi_3d.Cells)
volume = Volume(Geometry=solid_intersection)  # -> Volume, Centroid
volume_2 = Volume(Geometry=bounding_box.Box)  # -> Volume, Centroid
vector_2pt = Vector2Pt(PointA=volume.Centroid, PointB=volume_2.Centroid, Unitize=Toggle(True))  # -> simplify(Vector), Length

# ---- group: Bomb
number_slider = Slider(0, range=-100..0)

# ----
amplitude = Amplitude(Vector=vector_2pt.Vector, Amplitude=number_slider)
move = Move(Geometry=solid_intersection, Motion=amplitude)  # -> Geometry, Transform
volume_3 = Volume(Geometry=move.Geometry)  # -> flatten(Volume), Centroid
bounds = Bounds(Numbers=volume_3.Volume)
deconstruct_domain = DeconstructDomain(Domain=bounds)  # -> Start, End
gradient = Gradient(
    LowerLimit=deconstruct_domain.Start,
    UpperLimit=deconstruct_domain.End,
    Parameter=volume_3.Volume,
    stops=[0: RGB(48, 18, 59), 0.0294: RGB(56, 40, 112), 0.0588: RGB(63, 62, 156), 0.0882: RGB(68, 82, 193), 0.118: RGB(70, 102, 221), 0.147: RGB(71, 122, 241)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])
custom_preview = CustomPreview(Geometry=flatten(move.Geometry), Material=gradient)
