# Grasshopper definition T19.2.gh (Grasshopper 1.0.8)
# plug-ins: Weaverbird

base = Base(PlaneXY(0, 0, 0))
center_box = CenterBox(Base=base, X=Slider(15, range=0..100), Y=Slider(17, range=0..100), Z=Slider(17, range=0..100))
populate_3d = Populate3D(Region=center_box, Count=Slider(48, range=0..100), Seed=Slider(10, range=0..100))
list_item = ListItem(List=populate_3d, Index=0, Wrap=True)  # -> Item, Item1, Item2, Item3
nurbs_curve = NurbsCurve(Vertices=[list_item.Item, list_item.Item1, list_item.Item2, list_item.Item3], Degree=3, Periodic=False)  # -> Curve, Length, Domain
voronoi_3d = Voronoi3D(Points=populate_3d, Box=center_box)  # -> Cells, Boundary
curve_closest_point = CurveClosestPoint(Point=populate_3d, Curve=nurbs_curve.Curve)  # -> Point, Parameter, Distance
smaller_than = SmallerThan(FirstNumber=curve_closest_point.Distance, SecondNumber=Slider(6, range=0..100))  # -> SmallerThan, OrEqualTo
cull_pattern = CullPattern(List=voronoi_3d.Cells, CullPattern=smaller_than.SmallerThan)
solid_union = SolidUnion(Breps=cull_pattern)
mesh = Mesh(solid_union)
weaverbird_s_picture_frame = WeaverbirdsPictureFrame(MeshPolylines=mesh, Distance=Slider(5, range=0..10), InsetType=0)
weaverbird_s_mesh_thicken = WeaverbirdsMeshThicken(MeshCurves=weaverbird_s_picture_frame, Distance=Slider(0.5, range=0..1), OffsetType=0)
weaverbird_s_loop_subdivision = WeaverbirdsLoopSubdivision(MeshCurves=weaverbird_s_mesh_thicken, Level="3", SmoothNakedEdges=1)
custom_preview = CustomPreview(Geometry=weaverbird_s_loop_subdivision, Material=ColourSwatch(SwatchColor=RGB(83, 171, 230)))
