# Grasshopper definition T20.gh (Grasshopper 1.0.8)

md_slider = MDSlider(
    SliderMode=0,
    slider_value=Point(0.6912585003, 0.5620878266, 0.5),
    x_domain=Domain(-1, 1),
    y_domain=Domain(-1, 1),
    z_domain=Domain(0, 1))
curve = Curve(<curve referenced from the Rhino model>)
md_slider_2 = MDSlider(
    SliderMode=0,
    slider_value=Point(0.5675122331, 0.4771708047, 0.5),
    x_domain=Domain(-1, 1),
    y_domain=Domain(-1, 1),
    z_domain=Domain(0, 1))
end_points = EndPoints(Curve=curve)  # -> Start, End
number_slider = Slider(10, range=0..10)
number_slider_2 = Slider(49, range=0..100)
biarc = BiArc(StartPoint=end_points.Start, StartTangent=md_slider, EndPoint=end_points.End, EndTangent=md_slider_2, Ratio=0.5)  # -> FirstArc, SecondArc, BiArc
range = Range(Domain=Domain(0, 1), Steps=number_slider)
range_2 = Range(Domain=Domain(-1, 1), Steps=number_slider_2)
graph_mapper = GraphMapper(range, x0=0, x1=1, y0=0, y1=1, container_name="Bezier", cpx=[0, 1, 0, 1], cpy=[0, 0, 1, 0.6014492512])
graph_mapper_2 = GraphMapper(range, x0=0, x1=1, y0=0, y1=1, container_name="Bezier", cpx=[0, 0, 0, 1], cpy=[1, 0, 1, 1])
absolute = Absolute(Value=range_2)
perp_frames = PerpFrames(Curve=biarc.BiArc, Count=number_slider_2, Align=True)  # -> Frames, Parameters
multiplication = Multiplication(A=range, B=Slider(21.723, range=0..61))
expression = Expression(x=graph_mapper, y=graph_mapper_2, z=graft(absolute), u=Slider(8.5, range=0..50), Expression="(x*y+z*(1-z))*u")  # -> simplify(Result)
unit_z = UnitZ(Factor=multiplication)
deconstruct_plane = DeconstructPlane(Plane=perp_frames.Frames)  # -> Origin, XAxis, YAxis, ZAxis
amplitude = Amplitude(Vector=expr("-x", graft(deconstruct_plane.XAxis)), Amplitude=expression)  # -> simplify(Vector)
addition = Addition(A=unit_z, B=amplitude)  # -> simplify(Result)
number_slider_3 = Slider(4, range=0..10)
move = Move(Geometry=simplify(graft(deconstruct_plane.Origin)), Motion=addition)  # -> Geometry, Transform
series = Series(Start=0, Step=1, Count=number_slider_3)
series_2 = Series(Start=5, Step=1, Count=Slider(6, range=0..10))
list_item = ListItem(List=move.Geometry, Index=number_slider_3, Wrap=True)
unit_z_2 = UnitZ(Factor=Slider(3.789, range=0..7))
move_2 = Move(Geometry=list_item, Motion=unit_z_2)  # -> simplify(Geometry), Transform
list_item_2 = ListItem(List=move.Geometry, Index=series_2, Wrap=True)  # -> simplify(Item)
list_item_3 = ListItem(List=move.Geometry, Index=series, Wrap=True)  # -> simplify(Item)
point = Point([list_item_3, move_2.Geometry, list_item_2])
vector = Vector(expr("-x", graft(deconstruct_plane.XAxis)))
list_item_4 = ListItem(List=point, Index=0, Wrap=True)
list_item_5 = ListItem(List=reverse(point), Index=0, Wrap=True)
negative = Negative(Value=vector)
surface_from_points = SurfaceFromPoints(Points=flatten(point), UCount=expr("x+1", number_slider_2), Interpolate=False)
mesh_surface = MeshSurface(
    Surface=surface_from_points,
    UCount=expr("x+1", number_slider_2),
    VCount=expr("x+1", number_slider),
    Overhang=True,
    Equalize=False)
biarc_2 = BiArc(StartPoint=list_item_5, StartTangent=vector, EndPoint=list_item_4, EndTangent=negative, Ratio=Slider(0.314, range=0..1))  # -> FirstArc, SecondArc, BiArc
divide_curve = DivideCurve(Curve=simplify(biarc_2.BiArc), Count=number_slider, Kinks=False)  # -> simplify(Points), Tangents, Parameters
point_2 = Point([point, divide_curve.Points])
nurbs_curve = NurbsCurve(Vertices=point_2, Degree=3, Periodic=True)  # -> Curve, Length, Domain
surface = Surface(flatten(nurbs_curve.Curve))
is_planar = IsPlanar(Surface=surface, Interior=True)  # -> Planar, Plane
deconstruct_plane_2 = DeconstructPlane(Plane=is_planar.Plane)  # -> Origin, XAxis, YAxis, ZAxis
multiplication_2 = Multiplication(A=deconstruct_plane_2.ZAxis, B=Slider(1.25, range=0..10))
extrude = Extrude(Base=surface, Direction=multiplication_2)
