# Grasshopper definition T21.1.gh (Grasshopper 1.0.8)

surface = Surface(<surface referenced from the Rhino model>)
dimensions = Dimensions(Surface=surface)  # -> UDimension, VDimension
plane = Plane(PlaneXY(0, 0, 0))
plane_surface = PlaneSurface(Plane=plane, XSize=dimensions.UDimension, YSize=dimensions.VDimension)
area = Area(Geometry=plane_surface)  # -> Area, Centroid
number_slider = Slider(100, range=0..200)
number_slider_2 = Slider(45, range=0..100)
scale_nu = ScaleNU(
    Geometry=plane_surface,
    Plane=area.Centroid,
    ScaleX=Slider(0.998, range=0..1),
    ScaleY=Slider(0.951, range=0..1),
    ScaleZ=1)  # -> Geometry, Transform
populate_geometry = PopulateGeometry(Geometry=scale_nu.Geometry, Count=number_slider, Seed=number_slider_2)
surface_closest_point = SurfaceClosestPoint(Point=populate_geometry, Surface=scale_nu.Geometry)  # -> Point, UVPoint, Distance
random = Random(Range="360", Number=number_slider, Seed=number_slider_2)
evaluate_surface = EvaluateSurface(Surface=scale_nu.Geometry, Point=surface_closest_point.UVPoint)  # -> Point, Normal, UDirection, VDirection, Frame
rotate = Rotate(Geometry=evaluate_surface.Frame, Angle=degrees(random), Plane=evaluate_surface.Frame)  # -> Geometry, Transform
deconstruct_plane = DeconstructPlane(Plane=rotate.Geometry)  # -> Origin, XAxis, YAxis, ZAxis
adjust_plane = AdjustPlane(Plane=rotate.Geometry, Normal=deconstruct_plane.XAxis)
brep_plane = BrepPlane(Brep=scale_nu.Geometry, Plane=adjust_plane)  # -> flatten(Curves), Points
pipe = Pipe(Curve=brep_plane.Curves, Radius=Slider(0.23, range=0..1), Caps="1")  # -> flatten(Pipe)
trim_solid = TrimSolid(Shape=plane_surface, Cutters=pipe)
curve = Curve(flatten(scale_nu.Geometry))
curve_2 = Curve(flatten(trim_solid))
boundary_surfaces = BoundarySurfaces(Edges=[curve, curve_2])
bounding_box = BoundingBox(Content=boundary_surfaces, Plane=PlaneXY(0, 0, 0))  # -> Box, Box_2
surface_morph = SurfaceMorph(
    Geometry=boundary_surfaces,
    Reference=bounding_box.Box,
    Surface=reparameterize(surface),
    UDomain="1",
    VDomain="1",
    WDomain=Slider(0.1, range=0..0.1))
