# Grasshopper definition T21.2.gh (Grasshopper 1.0.8)

surface = Surface(<surface referenced from the Rhino model>)
number_slider = Slider(80, range=0..1000)
number_slider_2 = Slider(25, range=0..100)
populate_geometry = PopulateGeometry(Geometry=surface, Count=number_slider, Seed=number_slider_2)
random = Random(Range="360", Number=number_slider, Seed=number_slider_2)
surface_closest_point = SurfaceClosestPoint(Point=populate_geometry, Surface=surface)  # -> Point, UVPoint, Distance
degrees = Degrees(Radians=random)
evaluate_surface = EvaluateSurface(Surface=surface, Point=surface_closest_point.UVPoint)  # -> Point, Normal, UDirection, VDirection, Frame
rotate = Rotate(Geometry=evaluate_surface.Frame, Angle=degrees, Plane=evaluate_surface.Frame)  # -> Geometry, Transform
deconstruct_plane = DeconstructPlane(Plane=rotate.Geometry)  # -> Origin, XAxis, YAxis, ZAxis
adjust_plane = AdjustPlane(Plane=rotate.Geometry, Normal=deconstruct_plane.XAxis)
brep_plane = BrepPlane(Brep=surface, Plane=adjust_plane)  # -> flatten(Curves), Points
pipe = Pipe(Curve=brep_plane.Curves, Radius=Slider(0.25, range=0..1), Caps="1")
