# Grasshopper definition T22.gh (Grasshopper 1.0.8)

number_slider = Slider(34, range=0..100)
circle = Circle(Plane=PlaneXY(0, 0, 0), Radius=Slider(37.1, range=0..100))
division = Division(A=number_slider, B=Slider(1, range=0..20))
perp_frames = PerpFrames(Curve=circle, Count=number_slider, Align=True)  # -> Frames, Parameters
polygon = Polygon(Plane=perp_frames.Frames, Radius=Slider(11.55, range=0..100), Segments="3", FilletRadius=0)  # -> Polygon, Length
pi = Pi(Factor=Slider(8, range=0..100))
division_2 = Division(A=pi, B=Slider(4.06, range=0..10))
fillet = Fillet(Curve=polygon.Polygon, Radius=Slider(1.7, range=0..5))
multiplication = Multiplication(A=division_2, B=Slider(3.18, range=0..10))
range = Range(Domain=multiplication, Steps=division)
rotate = Rotate(Geometry=fillet, Angle=range, Plane=perp_frames.Frames)  # -> Geometry, Transform
list_item = ListItem(List=perp_frames.Frames, Index=0, Wrap=True)
list_item_2 = ListItem(List=rotate.Geometry, Index=0, Wrap=True)
division_3 = Division(A=number_slider, B="2")
construct_domain = ConstructDomain(DomainStart=division_3, DomainEnd=number_slider)
sub_list = SubList(List=rotate.Geometry, Domain=division_3, Wrap=True)  # -> List, Index
sub_list_2 = SubList(List=rotate.Geometry, Domain=construct_domain, Wrap=True)  # -> List, Index
cull_index = CullIndex(List=sub_list.List, Indices="0", Wrap=True)
rotate_2 = Rotate(Geometry=list_item_2, Angle=multiplication, Plane=list_item)  # -> Geometry, Transform
cull_index_2 = CullIndex(List=sub_list_2.List, Indices="34", Wrap=True)
merge = Merge(Data1=flatten(rotate_2.Geometry), Data2=flatten(cull_index))
merge_2 = Merge(Data1=flatten(cull_index_2), Data2=flatten(rotate_2.Geometry))
loft = Loft(Curves=merge, Options={Adjust=False, Closed=False, LoftEnds=0, LoftSimp=0, LoftType=0, Rebuild=10, Refit=0.01})
loft_2 = Loft(Curves=merge_2, Options={Adjust=False, Closed=False, LoftEnds=0, LoftSimp=0, LoftType=0, Rebuild=10, Refit=0.01})
