# Grasshopper definition T23.gh (Grasshopper 1.0.8)

number_slider = Slider(15, range=0..100)
number_slider_2 = Slider(6, range=0..100)
unit_x = UnitX(Factor=number_slider)
unit_y = UnitY(Factor=number_slider_2)
construct_point = ConstructPoint(XCoordinate=0, YCoordinate=0, ZCoordinate=0)
plane = Plane(PlaneXY(0, 0, 0))
square = Square(Plane=plane, Size=1, ExtentX=number_slider, ExtentY=number_slider_2)  # -> Cells, Points
multiplication = Multiplication(A=unit_x, B="2")
division = Division(A=unit_x, B="2")
move = Move(Geometry=construct_point, Motion=multiplication)  # -> Geometry, Transform
multiplication_2 = Multiplication(A=number_slider, B=number_slider_2)
area = Area(Geometry=square.Cells)  # -> Area, flatten(Centroid)
move_2 = Move(Geometry=construct_point, Motion=division)  # -> Geometry, Transform
multiplication_3 = Multiplication(A=unit_y, B="2")
division_2 = Division(A=Slider(0.734, range=-1.5..1.5), B=multiplication_2)
division_3 = Division(A=Slider(0.755, range=-1.5..1.5), B=multiplication_2)
move_3 = Move(Geometry=move.Geometry, Motion=multiplication_3)  # -> Geometry, Transform
series = Series(Start=0, Step=division_2, Count=multiplication_2)
division_4 = Division(A=unit_y, B="2")
series_2 = Series(Start=0, Step=division_3, Count=multiplication_2)
move_4 = Move(Geometry=move_2.Geometry, Motion=division_4)  # -> Geometry, Transform
box_2pt = Box2Pt(PointA=move_3.Geometry, PointB=construct_point, Plane=PlaneXY(0, 0, 0))
jitter = Jitter(List=series_2, Jitter=1, Seed=2)  # -> Values, Indices
jitter_2 = Jitter(List=series, Jitter=1, Seed=2)  # -> Values, Indices
unit_y_2 = UnitY(Factor=jitter_2.Values)
unit_x_2 = UnitX(Factor=jitter.Values)
move_5 = Move(Geometry=move_4.Geometry, Motion=unit_x)  # -> Geometry, Transform
deconstruct_brep = DeconstructBrep(Brep=box_2pt)  # -> Faces, Edges, Vertices
move_6 = Move(Geometry=area.Centroid, Motion=unit_y_2)  # -> Geometry, Transform
join_curves = JoinCurves(Curves=deconstruct_brep.Edges, Preserve=False)  # -> flatten(Curves)
move_7 = Move(Geometry=move_5.Geometry, Motion=unit_y)  # -> Geometry, Transform
move_8 = Move(Geometry=move_6.Geometry, Motion=unit_x_2)  # -> Geometry, Transform
box_2pt_2 = Box2Pt(PointA=move_4.Geometry, PointB=move_7.Geometry, Plane=PlaneXY(0, 0, 0))
move_9 = Move(Geometry=move_8.Geometry, Motion=unit_x)  # -> Geometry, Transform
surface = Surface(box_2pt_2)
move_10 = Move(Geometry=move_8.Geometry, Motion=unit_y)  # -> Geometry, Transform
move_11 = Move(Geometry=move_10.Geometry, Motion=unit_x)  # -> Geometry, Transform
merge = Merge(
    Data1=flatten(move_8.Geometry),
    Data2=flatten(move_9.Geometry),
    Data3=flatten(move_10.Geometry),
    Data4=flatten(move_11.Geometry))
voronoi = Voronoi(Points=merge, Boundary=box_2pt, BruteForceOverride=False)
divide_curve = DivideCurve(Curve=voronoi, Count=Slider(6, range=0..10), Kinks=False)  # -> Points, Tangents, Parameters
nurbs_curve = NurbsCurve(Vertices=divide_curve.Points, Degree=3, Periodic=True)  # -> Curve, Length, Domain
offset_curve = OffsetCurve(Curve=nurbs_curve.Curve, Distance=expr("-x", Slider(0.1, range=0..1)), Corners=1)  # -> flatten(Curve)
surface_2 = Surface(box_2pt_2)
surface_split = SurfaceSplit(Surface=surface_2, Curves=offset_curve)
list_item = ListItem(List=surface_split, Index="110", Wrap=True)
surface_3 = Surface(list_item)
