# Grasshopper definition T24.gh (Grasshopper 1.0.8)

point = Point(Point(31.48712856, -29.40679694, 0))
point_2 = Point(Point(12.87048039, 39.80212361, 17.10992637))
point_3 = Point(Point(-25.06780968, -8.371489038, -17.24015688))
point_4 = Point(Point(-14.53990534, -30.88529111, -20.31197672))
point_charge = PointCharge(Point=point, Charge=Slider(-0.09, range=-10..10), Decay=2)
point_charge_2 = PointCharge(Point=point_2, Charge=Slider(0.41, range=-10..10), Decay=2)
point_charge_3 = PointCharge(Point=point_3, Charge=Slider(2.02, range=-10..10), Decay=2)
spin_force = SpinForce(
    Plane=point_4,
    Strength=Slider(-0.076, range=-100..100),
    Radius=Slider(18, range=0..100),
    Decay=Slider(2.79, range=0..10))
surface = Surface(<surface referenced from the Rhino model>)
populate_geometry = PopulateGeometry(Geometry=surface, Count=Slider(322, range=0..500), Seed=1)
merge_fields = MergeFields(Fields=[point_charge_2, point_charge, point_charge_3, spin_force])
field_line = FieldLine(Field=merge_fields, Point=populate_geometry, Steps=1000, Accuracy=Slider(0.097, range=0..10), Method=3)
evaluate_field = EvaluateField(Field=merge_fields, Point=populate_geometry)  # -> Tensor, Strength
direction_display = DirectionDisplay(Field=merge_fields, Section=surface, Samples=1000)
tensor_display = TensorDisplay(Field=merge_fields, Section=surface, Samples=1000)
