# Grasshopper definition T25.gh (Grasshopper 1.0.8)

curve = Curve([<curve referenced from the Rhino model> x3])
divide_curve = DivideCurve(Curve=curve, Count=Slider(11, range=0..100), Kinks=False)  # -> Points, Tangents, Parameters
circle = Circle(Plane=divide_curve.Points, Radius=Slider(1.23, range=0..10))
divide_curve_2 = DivideCurve(Curve=circle, Count=Slider(5, range=0..10), Kinks=False)  # -> Points, Tangents, Parameters
point_charge = PointCharge(Point=divide_curve_2.Points, Charge=Slider(1.222, range=0..10), Decay=Slider(1.222, range=0..10))
merge_fields = MergeFields(Fields=point_charge)
range = Range(Domain=Domain(0, 1), Steps=10)
graph_mapper = GraphMapper(
    range,
    x0=0,
    x1=1,
    y0=0,
    y1=1,
    container_name="Bezier",
    cpx=[0, 0.8072212934, 0.3999428749, 1],
    cpy=[0, 0.1415573359, 0.9164127707, 0.5970467925])
field_line = FieldLine(Point=divide_curve_2.Points, Steps=Slider(200, range=0..1000), Accuracy=0.1, Method=3)
divide_curve_3 = DivideCurve(Curve=field_line, Count=10, Kinks=False)  # -> Points, Tangents, Parameters
multiplication = Multiplication(A=graph_mapper, B=Slider(1.25, range=0..10))
unit_z = UnitZ(Factor=multiplication)
move = Move(Geometry=divide_curve_3.Points, Motion=unit_z)  # -> simplify(Geometry), Transform
interpolate = Interpolate(Vertices=move.Geometry, Degree=3, Periodic=False, KnotStyle=1)  # -> Curve, Length, Domain
pipe = Pipe(Curve=interpolate.Curve, Radius=Slider(0.25, range=0..1), Caps="2")
