# Grasshopper definition T26.gh (Grasshopper 1.0.8)

base = Base(PlaneXY(0, 0, 0))
sphere = Sphere(Base=base, Radius=Slider(12.9, range=0..100))
populate_geometry = PopulateGeometry(Geometry=sphere, Count="1", Seed=Slider(37, range=0..100))
volume = Volume(Geometry=sphere)  # -> Volume, Centroid
sphere_2 = Sphere(Base=populate_geometry, Radius=Slider(6.9, range=0..100))
volume_2 = Volume(Geometry=sphere_2)  # -> Volume, Centroid
brep_brep = BrepBrep(BrepA=sphere, BrepB=sphere_2)  # -> Curves, Points
surface_split = SurfaceSplit(Surface=sphere, Curves=brep_brep.Curves)
vector_2pt = Vector2Pt(PointA=volume.Centroid, PointB=volume_2.Centroid, Unitize=False)  # -> Vector, Length
vector_display = VectorDisplay(Anchor=volume.Centroid, Vector=vector_2pt.Vector)
list_item = ListItem(List=surface_split, Index=0, Wrap=True)
surface = Surface(list_item)
curve = Curve(list_item)
populate_geometry_2 = PopulateGeometry(Geometry=list_item, Count=expr("3*x", Slider(90, range=0..100)), Seed=Slider(25, range=0..100))
contour = Contour(Shape=surface, Point=volume.Centroid, Direction=vector_2pt.Vector, Distance=Slider(3.06, range=0..10))
partition_list = PartitionList(List=populate_geometry_2, Size="3")
list_item_2 = ListItem(List=partition_list, Index=0, Wrap=True)  # -> Item, Item1, Item2
circle_3pt = Circle3Pt(PointA=list_item_2.Item, PointB=list_item_2.Item1, PointC=list_item_2.Item2)  # -> Circle, Plane, Radius
curve_curve = CurveCurve(CurveA=curve, CurveB=circle_3pt.Circle)  # -> Points, ParamsA, ParamsB
shatter = Shatter(Curve=circle_3pt.Circle, Parameters=curve_curve.ParamsB)
list_item_3 = ListItem(List=shatter, Index="1", Wrap=True)
pipe = Pipe(Curve=[contour, list_item_3, curve], Radius=Slider(0.2, range=0..1), Caps="2")
