# Grasshopper definition T27.gh (Grasshopper 1.0.8)

construct_point = ConstructPoint(XCoordinate=0, YCoordinate=0, ZCoordinate=0)
number_slider = Slider(33, range=0..100)
unit_z = UnitZ(Factor=Slider(3.4, range=0..100))
construct_domain = ConstructDomain(DomainStart=Slider(7, range=0..10), DomainEnd=Slider(30, range=0..100))
construct_domain_2 = ConstructDomain(DomainStart=Slider(-10, range=-10..10), DomainEnd=Slider(10, range=-10..10))
construct_domain_3 = ConstructDomain(DomainStart=Slider(-10, range=-10..10), DomainEnd=Slider(10, range=-10..10))
linear_array = LinearArray(Geometry=construct_point, Direction=unit_z, Count=number_slider)  # -> Geometry, Transform
random = Random(Range=construct_domain, Number=Slider(11, range=0..100), Seed=Slider(20, range=0..100))
random_2 = Random(Range=construct_domain_2, Number=Slider(32, range=0..100), Seed=Slider(58, range=0..100))
random_3 = Random(Range=construct_domain_3, Number=Slider(20, range=0..100), Seed=Slider(27, range=0..100))
repeat_data = RepeatData(Data=random, Length=number_slider)
circle = Circle(Plane=linear_array.Geometry, Radius=repeat_data)
unit_x = UnitX(Factor=random_2)
move = Move(Geometry=circle, Motion=unit_x)  # -> Geometry, Transform
unit_y = UnitY(Factor=random_3)
move_2 = Move(Geometry=move.Geometry, Motion=unit_y)  # -> Geometry, Transform
loft = Loft(Curves=move_2.Geometry, Options={Adjust=False, Closed=False, LoftEnds=0, LoftSimp=0, LoftType=0, Rebuild=10, Refit=0.01})
custom_preview = CustomPreview(Geometry=loft, Material=ColourSwatch(SwatchColor=RGB(101, 168, 164)))
