# Grasshopper definition T28.gh (Grasshopper 1.0.8)
# plug-ins: LunchBox

range = Range(Domain=Domain(0, 1), Steps=Slider(9, range=0..100))
graph_mapper = GraphMapper(
    range,
    x0=0,
    x1=1,
    y0=0,
    y1=1,
    container_name="Bezier",
    cpx=[0, 0.2878359854, 0.6623923779, 1],
    cpy=[0, 0.5487285852, 0.9120525122, 0.4779928327])
multiplication = Multiplication(A=range, B=Slider(8.264, range=0..20))
graph_mapper_2 = GraphMapper(
    range,
    x0=0,
    x1=1,
    y0=0,
    y1=1,
    container_name="Bezier",
    cpx=[0, 0.1560528874, 1, 1],
    cpy=[0.4085255265, 0.6267151833, 0.9848820567, 0.07936429977])
addition = Addition(A=Slider(2.349, range=0..20), B=multiplication)
multiplication_2 = Multiplication(A=graph_mapper, B=Slider(5.439, range=0..20))
construct_point = ConstructPoint(XCoordinate=0, YCoordinate=addition, ZCoordinate=multiplication_2)
expression = Expression(x=graph_mapper_2, y=Slider(0.297, range=0..2), Expression="pi/2*x*y")
number_slider = Slider(10, range=0..20)
number_slider_2 = Slider(0.552, range=0..1)
rotate_3d = Rotate3D(Geometry=construct_point, Angle=expr("-x", expression), Center=Point(0, 0, 0), Axis=Vector(0, 0, 1))  # -> Geometry, Transform
rotate = Rotate(Geometry=construct_point, Angle=expression, Plane=PlaneXY(0, 0, 0))  # -> Geometry, Transform
expression_2 = Expression(x=Slider(1, range=0..1), Expression="2*π*x")
construct_domain = ConstructDomain(DomainStart=number_slider_2, DomainEnd=number_slider_2)
interpolate = Interpolate(Vertices=construct_point, Degree=3, Periodic=False, KnotStyle=1)  # -> Curve, Length, Domain
interpolate_2 = Interpolate(Vertices=rotate.Geometry, Degree=3, Periodic=False, KnotStyle=1)  # -> Curve, Length, Domain
interpolate_3 = Interpolate(Vertices=rotate_3d.Geometry, Degree=3, Periodic=False, KnotStyle=1)  # -> Curve, Length, Domain
range_2 = Range(Domain=expression_2, Steps=number_slider)
plane = Plane(PlaneXY(0, 0, 0))
loft = Loft(
    Curves=[interpolate_2.Curve, interpolate.Curve, interpolate_3.Curve],
    Options={Adjust=False, Closed=False, LoftEnds=0, LoftSimp=0, LoftType=0, Rebuild=10, Refit=0.01})
rotate_2 = Rotate(Geometry=loft, Angle=range_2, Plane=plane)  # -> Geometry, Transform
range_3 = Range(Domain=construct_domain, Steps=number_slider)
plane_2 = Plane(PlaneXY(0, 0, 0))
space_truss_structure_1 = SpaceTrussStructure1(
    Surface=rotate_2.Geometry,
    UDivisions=Slider(4, range=0..100),
    VDivisions=Slider(9, range=0..100),
    TrussDepth=Slider(0.4, range=0..1))  # -> PrimaryLines, PrimaryLines_2, WebLines, StructureNodes
scale_nu = ScaleNU(Geometry=rotate_2.Geometry, Plane=plane_2, ScaleX=range_3, ScaleY=range_3, ScaleZ=1)  # -> Geometry, Transform
scale_nu_2 = ScaleNU(Geometry=scale_nu.Geometry, Plane=PlaneXY(0, 0, 0), ScaleX=1, ScaleY=1, ScaleZ=Slider(1.153, range=0..5))  # -> Geometry, Transform
plane_3 = Plane(PlaneXY(0, 0, 0))
rotate_3 = Rotate(Geometry=scale_nu_2.Geometry, Angle=1.570796327, Plane=plane_3)  # -> Geometry, Transform
scale_nu_3 = ScaleNU(Geometry=rotate_3.Geometry, Plane=PlaneXY(0, 0, 0), ScaleX=range_3, ScaleY=range_3, ScaleZ=1)  # -> Geometry, Transform
space_truss_structure_1_2 = SpaceTrussStructure1(
    Surface=rotate_3.Geometry,
    UDivisions=Slider(3, range=0..100),
    VDivisions=Slider(7, range=0..100),
    TrussDepth=Slider(0.25, range=0..1))  # -> PrimaryLines, PrimaryLines_2, WebLines, StructureNodes
plane_4 = Plane(PlaneXY(0, 0, 0))
rotate_4 = Rotate(Geometry=scale_nu_3.Geometry, Angle=1.570796327, Plane=plane_4)  # -> Geometry, Transform
plane_5 = Plane(PlaneXY(0, 0, 0))
scale_nu_4 = ScaleNU(Geometry=rotate_4.Geometry, Plane=plane_5, ScaleX=1, ScaleY=1, ScaleZ=Slider(1.23, range=0..10))  # -> Geometry, Transform
space_truss_structure_1_3 = SpaceTrussStructure1(
    Surface=scale_nu_4.Geometry,
    UDivisions=Slider(1, range=0..100),
    VDivisions=Slider(8, range=0..100),
    TrussDepth=Slider(0.15, range=0..1))  # -> PrimaryLines, PrimaryLines_2, WebLines, StructureNodes
curve = Curve([space_truss_structure_1.PrimaryLines, space_truss_structure_1.PrimaryLines_2, space_truss_structure_1.WebLines])
curve_2 = Curve([space_truss_structure_1_2.PrimaryLines, space_truss_structure_1_2.PrimaryLines_2, space_truss_structure_1_2.WebLines])
curve_3 = Curve([space_truss_structure_1_3.PrimaryLines, space_truss_structure_1_3.PrimaryLines_2, space_truss_structure_1_3.WebLines])
pipe = Pipe(Curve=curve, Radius=Slider(0.09, range=0..1), Caps="2")
pipe_2 = Pipe(Curve=curve_2, Radius=Slider(0.07, range=0..1), Caps="2")
pipe_3 = Pipe(Curve=curve_3, Radius=Slider(0.05, range=0..1), Caps="2")
colour_picker = ColourPicker(PickedColour=RGB(56, 110, 110))
colour_picker_2 = ColourPicker(PickedColour=RGB(100, 178, 96))
colour_picker_3 = ColourPicker(PickedColour=RGB(0, 255, 166))
custom_preview = CustomPreview(Geometry=pipe, Material=colour_picker)
custom_preview_2 = CustomPreview(Geometry=pipe_2, Material=colour_picker_2)
custom_preview_3 = CustomPreview(Geometry=pipe_3, Material=colour_picker_3)
