# Grasshopper definition T29.gh (Grasshopper 1.0.8)

number_slider = Slider(4.1, range=0..50)
number_slider_2 = Slider(25, range=0..100)
number_slider_3 = Slider(7, range=0..10)
expression = Expression(x=number_slider_2, Expression="x-1")
series = Series(Start=0, Step=number_slider, Count=number_slider_2)
expression_2 = Expression(Expression="2*π")
expression_3 = Expression(x=Slider(0.319, range=0..1), y=number_slider_3, Expression="2*π*x/y")
construct_point = ConstructPoint(XCoordinate=0, YCoordinate=series, ZCoordinate=0)
range = Range(Domain=expression_2, Steps=expression)
xz_plane = XZPlane(Origin=construct_point)
expression_4 = Expression(Expression="2*π")
rotate_plane = RotatePlane(Plane=xz_plane, Angle=range)  # -> graft(Plane)
range_2 = Range(Domain=expression_4, Steps=number_slider_3)
arc = Arc(Plane=rotate_plane, Radius=Slider(19.73, range=0..50), Angle=expression_3)  # -> Arc, Length
deconstruct_plane = DeconstructPlane(Plane=rotate_plane)  # -> Origin, XAxis, YAxis, ZAxis
expression_5 = Expression(x=number_slider, Expression="x-0.3")
cull_index = CullIndex(List=range_2, Indices="-1", Wrap=True)
rotate = Rotate(Geometry=arc.Arc, Angle=cull_index, Plane=rotate_plane)  # -> simplify(Geometry), Transform
amplitude = Amplitude(Vector=deconstruct_plane.ZAxis, Amplitude=expression_5)
expression_6 = Expression(x=number_slider_3, Expression="x-1")
end_points = EndPoints(Curve=rotate.Geometry)  # -> simplify(Start), End
range_3 = Range(Domain=Domain(0, 1), Steps=expression)
shift_list = ShiftList(List=end_points.End, Shift=expression_6, Wrap=True)  # -> simplify(List)
graft_tree = GraftTree(Tree=end_points.Start, IncludeEmptyLists=True, IncludeNullItems=True)  # -> simplify(Tree)
graft_tree_2 = GraftTree(Tree=shift_list, IncludeEmptyLists=True, IncludeNullItems=True)  # -> simplify(Tree)
graph_mapper = GraphMapper(
    range_3,
    x0=0,
    x1=1,
    y0=0,
    y1=1,
    container_name="Bezier",
    cpx=[0, 0.3325159848, 0.6975964308, 1],
    cpy=[0, 0.6886945963, 0.275862515, 1])
average = Average(Input=[graft_tree, graft_tree_2])
negative = Negative(Value=Slider(1.72, range=0..20))
shift_paths = ShiftPaths(Data=average, Offset=-1)
construct_domain = ConstructDomain(DomainStart=negative, DomainEnd=negative)
vector_2pt = Vector2Pt(PointA=rotate_plane, PointB=shift_paths, Unitize=False)  # -> Vector, Length
remap_numbers = RemapNumbers(Value=graph_mapper, Source=Domain(0, 1), Target=construct_domain)  # -> simplify(graft(Mapped)), Clipped
amplitude_2 = Amplitude(Vector=vector_2pt.Vector, Amplitude=remap_numbers.Mapped)
move = Move(Geometry=shift_paths, Motion=amplitude_2)  # -> Geometry, Transform
arc_3pt = Arc3Pt(PointA=end_points.Start, PointB=move.Geometry, PointC=shift_list)  # -> Arc, Plane, Radius
join_curves = JoinCurves(Curves=flatten([rotate.Geometry, arc_3pt.Arc]), Preserve=False)  # -> simplify(graft(Curves))
negative_2 = Negative(Value=Slider(2.387, range=0..10))
offset_curve = OffsetCurve(Curve=join_curves, Distance=negative_2, Plane=rotate_plane, Corners=1)  # -> simplify(Curve)
loft = Loft(
    Curves=[offset_curve, join_curves],
    Options={Adjust=False, Closed=False, LoftEnds=0, LoftSimp=0, LoftType=0, Rebuild=10, Refit=0.01})
extrude = Extrude(Base=loft, Direction=amplitude)
custom_preview = CustomPreview(Geometry=extrude, Material=ColourSwatch(SwatchColor=RGB(29, 128, 143)))
