# Grasshopper definition T30.gh (Grasshopper 1.0.8)

gene_pool = GenePool(Decimals=3, Maximum=1, Minimum=0, Value=[0, 0.337, 0.667, 1])
gene_pool_2 = GenePool(Decimals=2, Maximum=20, Minimum=0, Value=[18.55, 13.2, 10.85, 14.89])
plane = Plane(PlaneXY(0, 0, 0))
curve = Curve(reparameterize(<curve referenced from the Rhino model>))
triangular = Triangular(Plane=plane, Size=1, ExtentX=Slider(27, range=0..100), ExtentY=Slider(10, range=0..100))  # -> flatten(Cells), Points
pipe_variable = PipeVariable(Curve=curve, Parameters=gene_pool, Radii=gene_pool_2, Caps=0)
bounding_box = BoundingBox(Content=triangular.Cells, Plane=PlaneXY(0, 0, 0), UnionBox=True)  # -> Box, Box_2
map_to_surface = MapToSurface(Curve=triangular.Cells, Source=bounding_box.Box, Target=pipe_variable)
explode = Explode(Curve=map_to_surface, Recursive=True)  # -> Segments, Vertices
explode_2 = Explode(Curve=explode.Segments, Recursive=True)  # -> Segments, Vertices
cull_index = CullIndex(List=explode.Vertices, Indices="-1", Wrap=True)
average = Average(Input=cull_index)
average_2 = Average(Input=explode_2.Vertices)
curve_closest_point = CurveClosestPoint(Point=average, Curve=curve)  # -> Point, Parameter, Distance
surface_closest_point = SurfaceClosestPoint(Point=average, Surface=pipe_variable)  # -> Point, UVPoint, Distance
shift_paths = ShiftPaths(Data=average_2, Offset=-1)
construct_domain = ConstructDomain(DomainStart=Slider(0.339, range=0..1), DomainEnd=Slider(0.929, range=0..1))
bounds = Bounds(Numbers=flatten(curve_closest_point.Distance))
line = Line(StartPoint=average, EndPoint=shift_paths)
evaluate_surface = EvaluateSurface(Surface=pipe_variable, Point=surface_closest_point.UVPoint)  # -> Point, Normal, UDirection, VDirection, Frame
remap_numbers = RemapNumbers(Value=curve_closest_point.Distance, Source=bounds, Target=construct_domain)  # -> Mapped, Clipped
number_slider = Slider(2.42, range=0..10)
evaluate_curve = EvaluateCurve(Curve=reparameterize(line), Parameter=remap_numbers.Mapped)  # -> Point, Tangent, Angle
deconstruct_plane = DeconstructPlane(Plane=evaluate_surface.Frame)  # -> Origin, XAxis, YAxis, ZAxis
line_2 = Line(StartPoint=explode_2.Vertices, EndPoint=graft(evaluate_curve.Point))
negative = Negative(Value=number_slider)
amplitude = Amplitude(Vector=deconstruct_plane.ZAxis, Amplitude=[number_slider, negative])
shift_paths_2 = ShiftPaths(Data=line_2, Offset=-1)
join_curves = JoinCurves(Curves=shift_paths_2, Preserve=False)
move = Move(Geometry=average, Motion=amplitude)  # -> Geometry, Transform
extrude_point = ExtrudePoint(Base=join_curves, Point=move.Geometry)
