# Grasshopper definition T31.gh (Grasshopper 1.0.8)

number_slider = Slider(4.3, range=0..10)
number_slider_2 = Slider(36, range=0..100)
construct_point = ConstructPoint(XCoordinate=0, YCoordinate=0, ZCoordinate=0)
ellipse = Ellipse(Plane=construct_point, Radius1=Slider(20.01, range=0..100), Radius2=Slider(13.36, range=0..100))  # -> Ellipse, Focus1, Focus2
series = Series(Start=0, Step=number_slider, Count=number_slider_2)
construct_domain = ConstructDomain(DomainStart=0, DomainEnd=Slider(6, range=0..1000))
unit_z = UnitZ(Factor=series)
move = Move(Geometry=ellipse.Ellipse, Motion=unit_z)  # -> Geometry, Transform
series_2 = Series(Start=0, Step=construct_domain, Count=number_slider_2)
graph_mapper = GraphMapper(
    series_2,
    x0=0,
    x1=200,
    y0=0,
    y1=200,
    container_name="Bezier",
    cpx=[0, 0.3508132696, 0.6388682723, 1],
    cpy=[0, 0.4036876559, 0.5895295143, 1])
expression = Expression(x=number_slider, Expression="x-1")
rotate = Rotate(Geometry=move.Geometry, Angle=degrees(graph_mapper), Plane=PlaneXY(0, 0, 0))  # -> Geometry, Transform
subtraction = Subtraction(A=number_slider, B=expression)
negative = Negative(Value=Slider(3.5, range=0..5))
boundary_surfaces = BoundarySurfaces(Edges=rotate.Geometry)
unit_z_2 = UnitZ(Factor=number_slider)
offset_curve = OffsetCurve(Curve=rotate.Geometry, Distance=negative, Corners=1)
negative_2 = Negative(Value=Slider(0.55, range=0..10))
move_2 = Move(Geometry=offset_curve, Motion=unit_z_2)  # -> Geometry, Transform
cull_index = CullIndex(List=boundary_surfaces, Indices="0", Wrap=True)
number_slider_3 = Slider(19, range=0..100)
offset_curve_2 = OffsetCurve(Curve=cull_index, Distance=negative_2, Corners=1)
list_item = ListItem(List=flatten(move_2.Geometry), Index="-1", Wrap=True)
divide_curve = DivideCurve(Curve=offset_curve, Count=number_slider_3, Kinks=False)  # -> Points, Tangents, Parameters
unit_z_3 = UnitZ(Factor=Slider(1.3, range=0..10))
unit_z_4 = UnitZ(Factor=subtraction)
boundary_surfaces_2 = BoundarySurfaces(Edges=list_item)
move_3 = Move(Geometry=offset_curve_2, Motion=unit_z_3)  # -> Geometry, Transform
colour_picker = ColourPicker(PickedColour=RGB(50, 105, 128))
line_sdl = LineSDL(Start=divide_curve.Points, Direction=Vector(0, 0, 1), Length=expression)
extrude = Extrude(Base=[cull_index, boundary_surfaces_2], Direction=expr("-x", unit_z_4))
loft = Loft(Curves=line_sdl, Options={Adjust=False, Closed=True, LoftEnds=0, LoftSimp=0, LoftType=3, Rebuild=10, Refit=0.01})
pipe = Pipe(Curve=move_3.Geometry, Radius=Slider(0.13, range=0..1), Caps=0)
divide_curve_2 = DivideCurve(Curve=move_3.Geometry, Count=number_slider_3, Kinks=False)  # -> Points, Tangents, Parameters
divide_curve_3 = DivideCurve(Curve=offset_curve_2, Count=number_slider_3, Kinks=False)  # -> Points, Tangents, Parameters
list_item_2 = ListItem(List=flatten(loft), Index="-1", Wrap=True)
cull_index_2 = CullIndex(List=flatten(loft), Indices="-1", Wrap=True)
create_material = CreateMaterial(
    Diffuse=colour_picker,
    Specular=RGB(255, 255, 255),
    Emission=RGB(0, 0, 0),
    Transparency=0,
    Shine=Slider(20, range=0..100))
colour_picker_2 = ColourPicker(PickedColour=RGB(38, 45, 59))
line = Line(StartPoint=divide_curve_3.Points, EndPoint=divide_curve_2.Points)
shift_list = ShiftList(List=divide_curve_2.Points, Shift="1", Wrap=True)
colour_picker_3 = ColourPicker(PickedColour=RGB(51, 61, 54))
line_2 = Line(StartPoint=divide_curve_3.Points, EndPoint=shift_list)
custom_preview = CustomPreview(Geometry=loft, Material=create_material)
create_material_2 = CreateMaterial(
    Diffuse=colour_picker_2,
    Specular=RGB(255, 255, 255),
    Emission=RGB(0, 0, 0),
    Transparency=0,
    Shine=Slider(100, range=0..100))
custom_preview_2 = CustomPreview(Geometry=extrude, Material=create_material_2)
pipe_2 = Pipe(Curve=[line_2, line], Radius=Slider(0.1, range=0..1), Caps=2)
create_material_3 = CreateMaterial(
    Diffuse=colour_picker_3,
    Specular=RGB(255, 255, 255),
    Emission=RGB(0, 0, 0),
    Transparency=0,
    Shine=Slider(22, range=0..100))
custom_preview_3 = CustomPreview(Geometry=[pipe, pipe_2], Material=create_material_3)
