# Grasshopper definition T32.1.gh (Grasshopper 1.0.8)

pi = Pi(Factor=Slider(4, range=0..10))
construct_domain = ConstructDomain(DomainStart=0, DomainEnd=pi)
range = Range(Domain=construct_domain, Steps=Slider(360, range=0..1000))
expression = Expression(
    w=graft([Slider(5.39, range=0..50), Slider(2.13, range=0..50), Slider(8.01, range=0..50)]),
    t=range,
    Expression="sin(w*t)")
flip_matrix = FlipMatrix(Data=expression)
mass_addition = MassAddition(Input=flip_matrix)  # -> Result, PartialResults
construct_point = ConstructPoint(XCoordinate=range, YCoordinate=flatten(mass_addition.Result), ZCoordinate=0)
interpolate = Interpolate(Vertices=construct_point, Degree=3, Periodic=False, KnotStyle=1)  # -> Curve, Length, Domain
