# Grasshopper definition T32.2.gh (Grasshopper 1.0.8)

surface = Surface(<surface referenced from the Rhino model>)
area = Area(Geometry=surface)  # -> Area, Centroid
dimensions = Dimensions(Surface=surface)  # -> UDimension, VDimension
md_slider = MDSlider(
    SliderMode=0,
    slider_value=Point(0.3070459133, 0.3741581614, 0.5),
    x_domain=Domain(0, 1),
    y_domain=Domain(0, 1),
    z_domain=Domain(0, 1))
md_slider_2 = MDSlider(
    SliderMode=0,
    slider_value=Point(0.8728470221, 0.9207011897, 0.5),
    x_domain=Domain(0, 1),
    y_domain=Domain(0, 1),
    z_domain=Domain(0, 1))
md_slider_3 = MDSlider(
    SliderMode=0,
    slider_value=Point(0.3020086521, 0.6402439024, 0.5),
    x_domain=Domain(0, 1),
    y_domain=Domain(0, 1),
    z_domain=Domain(0, 1))
number_slider = Slider(25, range=0..100)
division = Division(A=dimensions.UDimension, B=dimensions.VDimension)
scale = Scale(Geometry=surface, Center=area.Centroid, Factor=Slider(1.065, range=0..10))  # -> Geometry, Transform
multiplication = Multiplication(A=division, B=number_slider)
integer = Integer(multiplication)
evaluate_surface = EvaluateSurface(Surface=reparameterize(scale.Geometry), Point=[md_slider, md_slider_2])  # -> Point, Normal, UDirection, VDirection, Frame
divide_surface = DivideSurface(Surface=surface, UCount=integer, VCount=number_slider)  # -> flatten(Points), Normals, Parameters
distance = Distance(PointA=divide_surface.Points, PointB=graft(evaluate_surface.Point))
flip_matrix = FlipMatrix(Data=distance)
sort_list = SortList(Keys=flip_matrix)  # -> Keys, ValuesA
number_slider_2 = Slider(0, range=0..100)
number_slider_3 = Slider(0, range=0..100)
list_item = ListItem(List=sort_list.Keys, Index="0", Wrap=True)  # -> flatten(Item)
expression = Expression(w=graft(Slider(0.224, range=0..100)), t=list_item, Expression="sin(w*t)²")
flip_matrix_2 = FlipMatrix(Data=expression)
mass_addition = MassAddition(Input=flip_matrix_2)  # -> Result, PartialResults
multiplication_2 = Multiplication(A=flatten(mass_addition.Result), B=Slider(19.777, range=0..50))
unit_z = UnitZ(Factor=multiplication_2)
move = Move(Geometry=divide_surface.Points, Motion=unit_z)  # -> Geometry, Transform
expression_2 = Expression(u=integer, Expression="u+1")
surface_from_points = SurfaceFromPoints(Points=move.Geometry, UCount=expression_2, Interpolate=False)
