# Grasshopper definition T33.gh (Grasshopper 1.0.8)

number_slider = Slider(33.71, range=0..100)
number_slider_2 = Slider(24.38, range=0..100)
negative = Negative(Value=number_slider)
negative_2 = Negative(Value=number_slider_2)
construct_domain = ConstructDomain(DomainStart=negative, DomainEnd=number_slider)
construct_domain_2 = ConstructDomain(DomainStart=negative_2, DomainEnd=number_slider_2)
xz_plane = XZPlane(Origin=Point(0, 0, 0))
rectangle = Rectangle(Plane=xz_plane, XSize=construct_domain, YSize=construct_domain_2, Radius=0)  # -> Rectangle, Length
deconstruct_brep = DeconstructBrep(Brep=rectangle.Rectangle)  # -> Faces, Edges, Vertices
area = Area(Geometry=rectangle.Rectangle)  # -> Area, Centroid
list_item = ListItem(List=deconstruct_brep.Vertices, Index="1", Wrap=True)
list_item_2 = ListItem(List=deconstruct_brep.Vertices, Index="2", Wrap=True)
list_item_3 = ListItem(List=deconstruct_brep.Vertices, Index="3", Wrap=True)
move = Move(Geometry=area.Centroid, Motion=Vector(0, 0, 10))  # -> Geometry, Transform
vector_2pt = Vector2Pt(PointA=list_item_2, PointB=list_item_3, Unitize=False)  # -> Vector, Length
distance = Distance(PointA=list_item, PointB=list_item_2)
line = Line(StartPoint=area.Centroid, EndPoint=move.Geometry)
amplitude = Amplitude(Vector=vector_2pt.Vector, Amplitude=Slider(30.96, range=0..50))
division = Division(A=distance, B="2")
unit_z = UnitZ(Factor=division)
move_2 = Move(Geometry=list_item, Motion=amplitude)  # -> Geometry, Transform
move_3 = Move(Geometry=list_item_2, Motion=amplitude)  # -> Geometry, Transform
move_4 = Move(Geometry=list_item, Motion=unit_z)  # -> Geometry, Transform
nurbs_curve = NurbsCurve(Vertices=[move_2.Geometry, list_item, move_4.Geometry, list_item_2, move_3.Geometry], Degree=3, Periodic=False)  # -> Curve, Length, Domain
revolution = Revolution(Curve=nurbs_curve.Curve, Axis=line, Domain=Domain(0, 6.283185307))
surface = Surface(reparameterize(revolution))
divide_domain² = DivideDomain²(Domain=surface, UCount=Slider(20, range=0..100), VCount=Slider(20, range=0..100))
surface_box = SurfaceBox(Surface=surface, Domain=divide_domain², Height=Slider(0, range=0..100))
deconstruct_brep_2 = DeconstructBrep(Brep=surface_box)  # -> Faces, Edges, Vertices
number_slider_3 = Slider(1.222, range=0..50)
point = Point(deconstruct_brep_2.Vertices)
scale_nu = ScaleNU(Geometry=point, Plane=PlaneXY(0, 0, 0), ScaleX=number_slider_3, ScaleY=number_slider_3, ScaleZ=number_slider_3)  # -> Geometry, Transform
line_2 = Line(StartPoint=point, EndPoint=scale_nu.Geometry)
pipe = Pipe(Radius=Slider(0.155, range=0..1), Caps="2")
